# Grasshopper definition GazeVisualizerTool.gh (Grasshopper 0.9.76)
# plug-ins: Python Interpreter, Ironbug

honeybee = Honeybee_Honeybee()  # -> Vviiiiiiiiiizzz; plug-in component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
ladybug = Ladybug_Ladybug()  # -> Vviiiiiiiiiizzz; plug-in component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

zone = Geometry(<brep referenced from the Rhino model>)
radglassmaterial = Honeybee_RadianceGlassMaterial(materialName="glass_.65", RTransmittance=".65", GTransmittance=".65", BTransmittance=".65", refractiveIndex=1.52)  # -> avrgTrans, RADMaterial; plug-in component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
createhbsrfs = Honeybee_createHBSrfs(geometry=zone)  # -> readMe, simplify(HBSurface); plug-in component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
window = Geometry(<brep referenced from the Rhino model>)
addhbglz = Honeybee_addHBGlz(HBObj=createhbsrfs.HBSurface, childSurfaces=flatten(window), RADMaterials=radglassmaterial.RADMaterial)  # -> HBObjWGLZ; plug-in component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
brep = Brep(addhbglz)

# ----
# Run simulation
number_slider = Slider(10, range=1..10)

open_weather_file = Ladybug_OpenEPWWeatherFile(open=Toggle(True))  # -> epwFile; plug-in component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
genstandardciesky = Honeybee_GenerateStandardCIESky(
    weatherFile=open_weather_file,
    month=Slider(7, range=0..12),
    day=Slider(21, range=0..21),
    hour=Slider(10, range=0..10),
    skyType="0")  # -> skyFilePath; plug-in component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

# ----
# Folder
panel = Panel("_")
int = Integer(number_slider)
concat = Concatenate(FragmentA="Test", FragmentB=panel, FragmentC=int)
panel_2 = Panel(concat)

# ----
# Set view
pt = Point(<point referenced from the Rhino model>)
comfortmannequin = Ladybug_ComfortMannequin(bodyLocation=pt)  # -> mannequinMesh, legend, legendBasePt; plug-in component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
series = Series(Start=0, Step="-40", Count=number_slider)
rad = Radians(Degrees=series)
item = ListItem(List=comfortmannequin.mannequinMesh, Index=121, Wrap=True)
facen = FaceNormals(Mesh=item)  # -> Centers, Normals
rotate = Rotate(Geometry=facen.Normals, Angle=rad, Plane=PlaneXY(0, 0, 0))  # -> Geometry, Transform
settheview = Ladybug_SetTheView(cameraLocation=facen.Centers, cameraDirection=rotate.Geometry)  # -> a; plug-in component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
pt_2 = Point(facen.Centers)
vdis = VectorDisplay(Anchor=facen.Centers, Vector=rotate.Geometry)

radparameters = Honeybee_RADParameters(quality=Slider(1, range=0..2))  # -> readMe, radParameters; plug-in component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
imagebasedsimulation = Honeybee_ImageBasedSimulation(
    skyFile=genstandardciesky,
    cameraType="1",
    simulationType="2",
    imageWidth="1000",
    imageHeight="1000",
    radParameters=radparameters.radParameters,
    backupImages=0)  # -> analysisRecipe; plug-in component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
rundaylightanalysis = Honeybee_RunDaylightSimulation(
    HBObjects=flatten(brep),
    analysisRecipe=imagebasedsimulation,
    writeRad=Toggle(True),
    runRad=Toggle(True),
    workingDir="C:\Susanne\",
    radFileName=panel_2,
    overwriteResults=True)  # -> readMe, analysisType, resultsUnit, results, testPts, luminance_files, radGeoFile, studyFolder, done; plug-in component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

# ----
# Intersection points
number_slider_2 = Slider(9, range=1..9)
series_2 = Series(Start=0, Step="-40", Count=number_slider_2)
rad_2 = Radians(Degrees=series_2)
rotate_2 = Rotate(Geometry=facen.Normals, Angle=rad_2, Plane=PlaneXY(0, 0, 0))  # -> Geometry, Transform
forwardraytracing = Ladybug_ForwardRaytracing(startPts=facen.Centers, startVectors=graft(rotate_2.Geometry), context=flatten(brep), numOfBounce="1", lastBounceLen="0")  # -> rays; plug-in component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
end = EndPoints(Curve=forwardraytracing)  # -> Start, End

importrad = Honeybee_ImportRad(radianceFile=rundaylightanalysis.radGeoFile)  # -> RADMaterials, RADSurfaces; plug-in component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
hdr_tif = Honeybee_ConvertHDRToTIF(HDRFilePath=rundaylightanalysis.luminance_files, adjustExposure=Toggle(True))  # -> TIFFFilePath; plug-in component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
viewer = Ladybug_ImageViewer(ImagePath_=hdr_tif, _scale_=1, DisableClickable=False, SaveImgWithCoords=False, scale=1)  # -> ImagePath, Colors, GIF

panel_3 = Panel(rundaylightanalysis.studyFolder)
workingdir = ListItem(List="C:\Susanne\", Index=0, Wrap=True)
imagedir = ListItem(List=panel_3, Index=0, Wrap=True)
runevalglare = PythonScript(Run=Toggle(True), WorkingDir=workingdir, ImageDir=imagedir, ViewDirection=number_slider)  # -> out, a
# ---------- runevalglare: Python ----------
import os
import glob
import sys

ImageFiles = [file for file in os.listdir(ImageDir) if file.endswith('_0.HDR')]

for index in range (len(ImageFiles)):
   os.system("evalglare.exe -d " +ImageDir+ImageFiles[index]+" > "+WorkingDir+str(ViewDirection)+'EvalGlare.txt')

a = []

os.chdir(WorkingDir)
for file in glob.glob("*.txt"):
   with open(file) as f:
      data = [x.split() for x in f]

   VC = data[-1]
   Ldata=data[1:-1]

#getting the number of maximum glare sources
   glare = max(l[0] for l in Ldata)

   if glare == 0:
      MaxValue=(max( Ldata, key=lambda x:(x[4])))
      M_La     =VC[2]
      M_Ls     =MaxValue[5]
      M_Omega  =MaxValue[6]
      M_pIndex =MaxValue[7]
      M_x      =str(0)
      M_y      =str(0)
      M_z      =str(0)

   elif glare != 0:
      MaxValue=(max( Ldata, key=lambda x:(x[4])))
      M_La     = VC[2]
      M_Ls     = MaxValue[4]
      M_Omega  = MaxValue[5]
      M_pIndex = MaxValue[6]
      M_x      = MaxValue[13]
      M_y      = MaxValue[14]
      M_z      = MaxValue[15]

   b = [M_La, M_Ls, M_Omega, M_pIndex, M_x, M_y, M_z]
   a.append(b)

print(a)
# ---------- end runevalglare ----------
python = PythonScript(x=runevalglare.a)  # -> out, a
# ---------- python: Python ----------
a=x
# ---------- end python ----------

python_2 = PythonScript(pts=end.End, fpts=end.End)  # -> out, a; inputs pts: list, fpts: Point3d
# ---------- python_2: Python ----------
import sys
b=[]
for pts in fpts:
   print(pts)
# ---------- end python_2 ----------
weave = Weave(Pattern=[0, 1], Stream0=python.a, Stream1=python_2.out, NullGaps=False)
num = Number(weave)
gazeviz = PythonScript(List=num)  # -> x, y, z; inputs List: list
# ---------- gazeviz: Python ----------
import math

print(List)

x=[] 
y=[] 
z=[] 

Ls     =float(List[2]) 
La     =float(List[0]) 
Omega  =float(List[4]) 
pIndex =float(List[6]) 
x_gla  =float(List[7]) 
y_gla  =float(List[8]) 
z_gla  =float(List[9]) 
x_cam  =float(List[1]) 
y_cam  =float(List[3]) 
z_cam  =float(List[5]) 

if Ls > 0:

    x_gla1  = x_gla/math.sqrt(x_gla**2+y_gla**2+z_gla**2)
    y_gla1  = y_gla/math.sqrt(x_gla**2+y_gla**2+z_gla**2)
    z_gla1  = z_gla/math.sqrt(x_gla**2+y_gla**2+z_gla**2)
    x_cam1  = x_cam/math.sqrt(x_cam**2+y_cam**2+z_cam**2)
    y_cam1  = y_cam/math.sqrt(x_cam**2+y_cam**2+z_cam**2)
    z_cam1  = z_cam/math.sqrt(x_cam**2+y_cam**2+z_cam**2)
    glareimpact=Ls*Omega/pIndex
    DistAngle  =math.acos(x_gla1 * x_cam1 + y_gla1 * y_cam1 + z_gla1 * z_cam1)
    Shift      =1.92-0.56*math.log10(glareimpact)/(math.log10(La)*DistAngle)
    Iphi       =math.atan2(y_cam1,x_cam1)
    Itheta     =math.atan2(z_cam1,math.sqrt(x_cam1**2+y_cam1**2))
  
    Gphi   =math.atan2(y_gla1,x_gla1)
    Gtheta =math.atan2(z_gla1,math.sqrt(x_gla1**2+y_gla1**2))

    GIphi  = Iphi - Gphi

  
    if GIphi > math.pi:
        kGIphi = GIphi - (math.pi*2) 
    else:
        kGIphi = GIphi
    print(kGIphi)

    sign  = lambda a: 1 if a>0 else -1 if a<0 else 0
    gamma = sign(kGIphi) * Shift
    alpha = sign(kGIphi) * Shift  
    
    vdd  =[[x_cam1],[y_cam1],[z_cam1]]
    Rz   =[[math.cos(alpha),-math.sin(alpha), 0],[math.sin(alpha),math.cos(alpha),0],[0,0,1]]

    result2 = [[0],[0],[0]]  
    for i in range(len(Rz)):
       for j in range(len(vdd[0])):
          for k in range(len(vdd)):
              result2[i][j] += Rz[i][k] * vdd[k][j]
    R2 = []
    for r in result2:
       R2.append(r)

    VDf=R2
    xnew=VDf[0][0]
    ynew=VDf[1][0]
    znew=VDf[2][0]
    
    x.append(xnew)
    y.append(ynew)
    z.append(znew)

print(x)
print(y)
print(z)
# ---------- end gazeviz ----------
vec = VectorXYZ(XComponent=gazeviz.x, YComponent=gazeviz.y, ZComponent=gazeviz.z)  # -> Vector, Length
vec_2 = Vector(vec.Vector)
vdis_2 = VectorDisplay(Anchor=pt_2, Vector=vec_2)
panel_4 = Panel(vec.Vector)
