# Grasshopper definition geometri06.gh (Grasshopper 0.9.76)
# plug-ins: Python Interpreter, Ironbug

setradmaterials = Honeybee_SetRadianceMaterials()  # -> simplify(modifiedHBObject); plug-in component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
ladybug = Ladybug_Ladybug()  # -> Vviiiiiiiiiizzz; plug-in component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
honeybee = Honeybee_Honeybee()  # -> Vviiiiiiiiiizzz; plug-in component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
brep = Brep(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)
wires = BrepWireframe(Brep=brep, Density=-1)
createhbsrfs = Honeybee_createHBSrfs(geometry=brep, RADMaterial=setradmaterials)  # -> readMe, simplify(HBSurface); plug-in component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
open_weather_file = Ladybug_OpenEPWWeatherFile(open=Toggle(True))  # -> epwFile; plug-in component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
radparameters = Honeybee_RADParameters(quality=Slider(2, range=0..2))  # -> readMe, radParameters; plug-in component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
panel = Panel(createhbsrfs.HBSurface)
genstandardciesky = Honeybee_GenerateStandardCIESky(
    weatherFile=open_weather_file,
    month=Slider(6, range=0..12),
    day=Slider(21, range=0..21),
    hour=Slider(10, range=0..10),
    skyType="0")  # -> skyFilePath; plug-in component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

# ----
# set the view
pt = Point(Point(-4, 10, 0))
comfortmannequin = Ladybug_ComfortMannequin(bodyLocation=pt)  # -> mannequinMesh, legend, legendBasePt; plug-in component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
item = ListItem(List=comfortmannequin.mannequinMesh, Index=121, Wrap=True)
series = Series(Start=0, Step="-60", Count=Slider(6, range=1..6))
facen = FaceNormals(Mesh=item)  # -> Centers, Normals
rad = Radians(Degrees=series)
panel_2 = Panel(series)
panel_3 = Panel(facen.Centers)
rotate = Rotate(Geometry=facen.Normals, Angle=rad, Plane=PlaneXY(0, 0, 0))  # -> Geometry, Transform
vdis = VectorDisplay(Anchor=facen.Centers, Vector=rotate.Geometry)
panel_4 = Panel(rotate.Geometry)
settheview = Ladybug_SetTheView(cameraLocation=facen.Centers, cameraDirection=rotate.Geometry)  # -> a; plug-in component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

imagebasedsimulation = Honeybee_ImageBasedSimulation(skyFile=genstandardciesky, cameraType="1", simulationType="2", radParameters=radparameters.radParameters, backupImages=0)  # -> analysisRecipe; plug-in component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
rundaylightanalysis = Honeybee_RunDaylightSimulation(
    HBObjects=flatten(createhbsrfs.HBSurface),
    analysisRecipe=imagebasedsimulation,
    writeRad=Toggle(True),
    runRad=Toggle(True),
    radFileName="glare",
    overwriteResults=True)  # -> readMe, analysisType, resultsUnit, results, testPts, resultFiles, radGeoFile, studyFolder, done; plug-in component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
panel_5 = Panel(rundaylightanalysis.radGeoFile)
hdr_tif = Honeybee_ConvertHDRToTIF(HDRFilePath=rundaylightanalysis.resultFiles, adjustExposure=Toggle(True))  # -> TIFFFilePath; plug-in component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
concat = Concatenate(FragmentA=panel_3, FragmentB=panel_4)
panel_6 = Panel(concat)
viewer = Ladybug_ImageViewer(ImagePath_=hdr_tif, _scale_=1, DisableClickable=False, SaveImgWithCoords=False, scale=1)  # -> ImagePath, Colors, GIF
