# Grasshopper definition geometri08.gh (Grasshopper 0.9.76)
# plug-ins: Python Interpreter, Ironbug

setradmaterials = Honeybee_SetRadianceMaterials()  # -> simplify(modifiedHBObject); plug-in component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
ladybug = Ladybug_Ladybug()  # -> Vviiiiiiiiiizzz; plug-in component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
honeybee = Honeybee_Honeybee()  # -> Vviiiiiiiiiizzz; plug-in component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

# ----
# set the view
pt = Point(<point referenced from the Rhino model>)
comfortmannequin = Ladybug_ComfortMannequin(bodyLocation=pt)  # -> mannequinMesh, legend, legendBasePt; plug-in component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
item = ListItem(List=comfortmannequin.mannequinMesh, Index=121, Wrap=True)
series = Series(Start=0, Step="-60", Count=Slider(6, range=1..6))
facen = FaceNormals(Mesh=item)  # -> Centers, Normals
rad = Radians(Degrees=series)
panel = Panel(series)
rotate = Rotate(Geometry=facen.Normals, Angle=rad, Plane=PlaneXY(0, 0, 0))  # -> Geometry, Transform
vdis = VectorDisplay(Anchor=facen.Centers, Vector=rotate.Geometry)
settheview = Ladybug_SetTheView(cameraLocation=facen.Centers, cameraDirection=rotate.Geometry)  # -> a; plug-in component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

brep = Brep(<brep referenced from the Rhino model>)
wires = BrepWireframe(Brep=brep, Density=-1)
createhbsrfs = Honeybee_createHBSrfs(geometry=brep, RADMaterial=setradmaterials)  # -> readMe, simplify(HBSurface); plug-in component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
open_weather_file = Ladybug_OpenEPWWeatherFile(open=Toggle(True))  # -> epwFile; plug-in component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
radparameters = Honeybee_RADParameters(quality=Slider(0, range=0..2), ab="3", ad="4096", as="2048", ar="512", aa="0.1")  # -> readMe, radParameters; plug-in component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
genstandardciesky = Honeybee_GenerateStandardCIESky(
    weatherFile=open_weather_file,
    month=Slider(4, range=0..12),
    day=Slider(21, range=0..21),
    hour=Slider(10, range=0..10),
    skyType="0")  # -> skyFilePath; plug-in component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
panel_2 = Panel(createhbsrfs.HBSurface)
rep = ReplaceText(Text=facen.Centers, Find="{", RecursiveReplace=False)
rep_2 = ReplaceText(Text=rep, Find="}", RecursiveReplace=False)
imagebasedsimulation = Honeybee_ImageBasedSimulation(skyFile=genstandardciesky, cameraType="1", simulationType="2", radParameters=radparameters.radParameters, backupImages=0)  # -> analysisRecipe; plug-in component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
concat = Concatenate(FragmentA=rep_2, FragmentB=rotate.Geometry)
panel_3 = Panel(concat)
rundaylightanalysis = Honeybee_RunDaylightSimulation(
    HBObjects=flatten(createhbsrfs.HBSurface),
    analysisRecipe=imagebasedsimulation,
    writeRad=Toggle(True),
    runRad=Toggle(True),
    radFileName="glare",
    overwriteResults=True)  # -> readMe, analysisType, resultsUnit, results, testPts, luminance_files, radGeoFile, studyFolder, done; plug-in component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
forwardraytracing = Ladybug_ForwardRaytracing(startPts=facen.Centers, startVectors=graft(rotate.Geometry), context=flatten(brep), numOfBounce="1", lastBounceLen="0")  # -> rays; plug-in component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
end = EndPoints(Curve=forwardraytracing)  # -> Start, End

rep_3 = ReplaceText(Text=panel_3, Find=",", RecursiveReplace=False)
rep_4 = ReplaceText(Text=rep_3, Find="{", Replace=" ", RecursiveReplace=False)
rep_5 = ReplaceText(Text=rep_4, Find="}", RecursiveReplace=False)

panel_4 = Panel(end.End)
importrad = Honeybee_ImportRad(radianceFile=rundaylightanalysis.radGeoFile)  # -> RADMaterials, RADSurfaces; plug-in component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
hdr_tif = Honeybee_ConvertHDRToTIF(HDRFilePath=rundaylightanalysis.luminance_files, adjustExposure=Toggle(True))  # -> TIFFFilePath; plug-in component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
area = Area(Geometry=importrad.RADSurfaces)  # -> Area, Centroid
panel_5 = Panel(rep_5)
rep_6 = ReplaceText(Text=panel_4, Find="{", RecursiveReplace=False)
viewer = Ladybug_ImageViewer(ImagePath_=hdr_tif, _scale_=1, DisableClickable=False, SaveImgWithCoords=False, scale=1)  # -> ImagePath, Colors, GIF
tag = TextTag(Location=area.Centroid, Text=importrad.RADMaterials)
panel_6 = Panel(rep_6)
rep_7 = ReplaceText(Text=panel_6, RecursiveReplace=False)
concat_2 = Concatenate(FragmentA=rep_7, FragmentB=rep_2)
cluster = Cluster(T=concat_2)
panel_7 = Panel(cluster)

# ==== cluster Cluster
T = ClusterInput()
rep = ReplaceText(Text=T, Find="}", Replace=" ", RecursiveReplace=False)
rep_2 = ReplaceText(Text=rep, Find=",", RecursiveReplace=False)
R = ClusterOutput(rep_2)
