# Grasshopper definition geometri11.gh (Grasshopper 0.9.76)
# plug-ins: Python Interpreter, Human, LunchBox, Ironbug

honeybee = Honeybee_Honeybee()  # -> Vviiiiiiiiiizzz; plug-in component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
ladybug = Ladybug_Ladybug()  # -> Vviiiiiiiiiizzz; plug-in component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
zone = Geometry(<brep referenced from the Rhino model>)
radglassmaterial = Honeybee_RadianceGlassMaterial(materialName="glass_.65", RTransmittance=".65", GTransmittance=".65", BTransmittance=".65", refractiveIndex=1.52)  # -> avrgTrans, RADMaterial; plug-in component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
createhbsrfs = Honeybee_createHBSrfs(geometry=zone)  # -> readMe, simplify(HBSurface); plug-in component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
window = Geometry(<brep referenced from the Rhino model>)

# ----
# set the view
pt = Point(<point referenced from the Rhino model>)
comfortmannequin = Ladybug_ComfortMannequin(bodyLocation=pt)  # -> mannequinMesh, legend, legendBasePt; plug-in component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
item = ListItem(List=comfortmannequin.mannequinMesh, Index=121, Wrap=True)
series = Series(Start=0, Step="-60", Count=Slider(1, range=1..6))
rad = Radians(Degrees=series)
panel = Panel(series)
facen = FaceNormals(Mesh=item)  # -> Centers, Normals
rotate = Rotate(Geometry=facen.Normals, Angle=rad, Plane=PlaneXY(0, 0, 0))  # -> Geometry, Transform
vdis = VectorDisplay(Anchor=facen.Centers, Vector=rotate.Geometry)
settheview = Ladybug_SetTheView(cameraLocation=facen.Centers, cameraDirection=rotate.Geometry)  # -> a; plug-in component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

addhbglz = Honeybee_addHBGlz(HBObj=createhbsrfs.HBSurface, childSurfaces=flatten(window), RADMaterials=radglassmaterial.RADMaterial)  # -> HBObjWGLZ; plug-in component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

rep = ReplaceText(Text=facen.Centers, Find="{", RecursiveReplace=False)
rep_2 = ReplaceText(Text=rep, Find="}", RecursiveReplace=False)
concat = Concatenate(FragmentA=rep_2, FragmentB=rotate.Geometry)
rep_3 = ReplaceText(Text=concat, Find=",", RecursiveReplace=False)
rep_4 = ReplaceText(Text=rep_3, Find="{", Replace=" ", RecursiveReplace=False)
rep_5 = ReplaceText(Text=rep_4, Find="}", RecursiveReplace=False)
panel_2 = Panel(rep_5)

panel_3 = Panel("4")
panel_4 = Panel("2048")
panel_5 = Panel("4096")
panel_6 = Panel("512")
panel_7 = Panel("0.1")
open_weather_file = Ladybug_OpenEPWWeatherFile(open=Toggle(True))  # -> epwFile; plug-in component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
brep = Brep(addhbglz)
radparameters = Honeybee_RADParameters(quality=Slider(1, range=0..2))  # -> readMe, radParameters; plug-in component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
wires = BrepWireframe(Brep=brep, Density=-1)
genstandardciesky = Honeybee_GenerateStandardCIESky(
    weatherFile=open_weather_file,
    month=Slider(4, range=0..12),
    day=Slider(21, range=0..21),
    hour=Slider(10, range=0..10),
    skyType="0")  # -> skyFilePath; plug-in component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
brep_2 = Brep(<brep referenced from the Rhino model>)
imagebasedsimulation = Honeybee_ImageBasedSimulation(
    skyFile=genstandardciesky,
    cameraType="1",
    simulationType="2",
    imageWidth="800",
    imageHeight="800",
    radParameters=radparameters.radParameters,
    backupImages=0)  # -> analysisRecipe; plug-in component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
createhbsrfs_2 = Honeybee_createHBSrfs(geometry=brep_2)  # -> readMe, simplify(HBSurface); plug-in component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
brep_3 = Brep([createhbsrfs_2.HBSurface, brep])
rundaylightanalysis = Honeybee_RunDaylightSimulation(
    HBObjects=flatten(brep_3),
    analysisRecipe=imagebasedsimulation,
    writeRad=Toggle(True),
    runRad=Toggle(True),
    radFileName="glare",
    overwriteResults=True)  # -> readMe, analysisType, resultsUnit, results, testPts, luminance_files, radGeoFile, studyFolder, done; plug-in component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
forwardraytracing = Ladybug_ForwardRaytracing(startPts=facen.Centers, startVectors=graft(rotate.Geometry), context=flatten(brep), numOfBounce="1", lastBounceLen="0")  # -> rays; plug-in component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
layers = CreateModifyLayers(LayerName="viewpoint", Visibility=Toggle(True), DeleteLayer=False, enableFullPath=False)  # -> LayerNames, LayerFullPath
end = EndPoints(Curve=forwardraytracing)  # -> Start, End
importrad = Honeybee_ImportRad(radianceFile=rundaylightanalysis.radGeoFile)  # -> RADMaterials, RADSurfaces; plug-in component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
sph = Sphere(Base=end.End, Radius="0.05")
hdr_tif = Honeybee_ConvertHDRToTIF(HDRFilePath=rundaylightanalysis.luminance_files, adjustExposure=Toggle(True))  # -> TIFFFilePath; plug-in component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
area = Area(Geometry=importrad.RADSurfaces)  # -> Area, Centroid
bake = ObjectBake(
    BakeToggle=Toggle(True),
    GeometryObjects=sph,
    Layer="viewpoint",
    ObjectName="viewpoint",
    ObjectColor=RGB(255, 255, 255),
    LayerColor=RGB(255, 255, 255))

rep_6 = ReplaceText(Text=end.End, Find="{", RecursiveReplace=False)
rep_7 = ReplaceText(Text=facen.Centers, Find="{", RecursiveReplace=False)
rep_8 = ReplaceText(Text=rep_7, Find="}", RecursiveReplace=False)
rep_9 = ReplaceText(Text=rep_6, RecursiveReplace=False)
concat_2 = Concatenate(FragmentA=rep_9, FragmentB=rep_8)
cluster = Cluster(T=concat_2)
panel_8 = Panel(cluster)

viewer = Ladybug_ImageViewer(ImagePath_=hdr_tif, _scale_=1, DisableClickable=False, SaveImgWithCoords=False, scale=1)  # -> ImagePath, Colors, GIF
tag = TextTag(Location=area.Centroid, Text=importrad.RADMaterials)

# ==== cluster Cluster
T = ClusterInput()
rep = ReplaceText(Text=T, Find="}", Replace=" ", RecursiveReplace=False)
rep_2 = ReplaceText(Text=rep, Find=",", RecursiveReplace=False)
R = ClusterOutput(rep_2)
