# Grasshopper definition geometri12_python.gh (Grasshopper 0.9.76)
# plug-ins: Python Interpreter, LunchBox, Ironbug

honeybee = Honeybee_Honeybee()  # -> Vviiiiiiiiiizzz; plug-in component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
ladybug = Ladybug_Ladybug()  # -> Vviiiiiiiiiizzz; plug-in component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
zone = Geometry(<brep referenced from the Rhino model>)
radglassmaterial = Honeybee_RadianceGlassMaterial(materialName="glass_.65", RTransmittance=".65", GTransmittance=".65", BTransmittance=".65", refractiveIndex=1.52)  # -> avrgTrans, RADMaterial; plug-in component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
createhbsrfs = Honeybee_createHBSrfs(geometry=zone)  # -> readMe, simplify(HBSurface); plug-in component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
window = Geometry(<brep referenced from the Rhino model>)

# ----
# set the view
pt = Point(<point referenced from the Rhino model>)
comfortmannequin = Ladybug_ComfortMannequin(bodyLocation=pt)  # -> mannequinMesh, legend, legendBasePt; plug-in component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
item = ListItem(List=comfortmannequin.mannequinMesh, Index=121, Wrap=True)
series = Series(Start=0, Step="-60", Count=Slider(1, range=1..6))
rad = Radians(Degrees=series)
panel = Panel(series)
facen = FaceNormals(Mesh=item)  # -> Centers, Normals
rotate = Rotate(Geometry=facen.Normals, Angle=rad, Plane=PlaneXY(0, 0, 0))  # -> Geometry, Transform
vdis = VectorDisplay(Anchor=facen.Centers, Vector=rotate.Geometry)
settheview = Ladybug_SetTheView(cameraLocation=facen.Centers, cameraDirection=rotate.Geometry)  # -> a; plug-in component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

addhbglz = Honeybee_addHBGlz(HBObj=createhbsrfs.HBSurface, childSurfaces=flatten(window), RADMaterials=radglassmaterial.RADMaterial)  # -> HBObjWGLZ; plug-in component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

rep = ReplaceText(Text=facen.Centers, Find="{", RecursiveReplace=False)
rep_2 = ReplaceText(Text=rep, Find="}", RecursiveReplace=False)
concat = Concatenate(FragmentA=rep_2, FragmentB=rotate.Geometry)
rep_3 = ReplaceText(Text=concat, Find=",", RecursiveReplace=False)
rep_4 = ReplaceText(Text=rep_3, Find="{", Replace=" ", RecursiveReplace=False)
rep_5 = ReplaceText(Text=rep_4, Find="}", RecursiveReplace=False)
panel_2 = Panel(rep_5)

panel_3 = Panel("4")
panel_4 = Panel("2048")
panel_5 = Panel("4096")
panel_6 = Panel("512")
panel_7 = Panel("0.1")
open_weather_file = Ladybug_OpenEPWWeatherFile(open=Toggle(True))  # -> epwFile; plug-in component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
brep = Brep(addhbglz)
radparameters = Honeybee_RADParameters(quality=Slider(1, range=0..2))  # -> readMe, radParameters; plug-in component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
wires = BrepWireframe(Brep=brep, Density=-1)
genstandardciesky = Honeybee_GenerateStandardCIESky(
    weatherFile=open_weather_file,
    month=Slider(4, range=0..12),
    day=Slider(21, range=0..21),
    hour=Slider(10, range=0..10),
    skyType="0")  # -> skyFilePath; plug-in component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
brep_2 = Brep(<brep referenced from the Rhino model>)
imagebasedsimulation = Honeybee_ImageBasedSimulation(
    skyFile=genstandardciesky,
    cameraType="1",
    simulationType="2",
    imageWidth="600",
    imageHeight="600",
    radParameters=radparameters.radParameters,
    backupImages=0)  # -> analysisRecipe; plug-in component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
createhbsrfs_2 = Honeybee_createHBSrfs(geometry=brep_2)  # -> readMe, simplify(HBSurface); plug-in component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
brep_3 = Brep(brep)
rundaylightanalysis = Honeybee_RunDaylightSimulation(
    HBObjects=flatten(brep_3),
    analysisRecipe=imagebasedsimulation,
    writeRad=Toggle(True),
    runRad=Toggle(True),
    radFileName="glare02",
    overwriteResults=True)  # -> readMe, analysisType, resultsUnit, results, testPts, luminance_files, radGeoFile, studyFolder, done; plug-in component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
forwardraytracing = Ladybug_ForwardRaytracing(startPts=facen.Centers, startVectors=graft(rotate.Geometry), context=flatten(brep), numOfBounce="1", lastBounceLen="0")  # -> rays; plug-in component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
end = EndPoints(Curve=forwardraytracing)  # -> Start, End
importrad = Honeybee_ImportRad(radianceFile=rundaylightanalysis.radGeoFile)  # -> RADMaterials, RADSurfaces; plug-in component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
sph = Sphere(Base=end.End, Radius="0.05")
hdr_tif = Honeybee_ConvertHDRToTIF(HDRFilePath=rundaylightanalysis.luminance_files, adjustExposure=Toggle(True))  # -> TIFFFilePath; plug-in component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

rep_6 = ReplaceText(Text=end.End, Find="{", RecursiveReplace=False)
rep_7 = ReplaceText(Text=facen.Centers, Find="{", RecursiveReplace=False)
rep_8 = ReplaceText(Text=rep_7, Find="}", RecursiveReplace=False)
rep_9 = ReplaceText(Text=rep_6, RecursiveReplace=False)
concat_2 = Concatenate(FragmentA=rep_9, FragmentB=rep_8)
cluster = Cluster(T=concat_2)
panel_8 = Panel(cluster)

cluster_2 = Cluster_2(T=end.End)
area = Area(Geometry=importrad.RADSurfaces)  # -> Area, Centroid
bake = ObjectBake(
    BakeToggle=Toggle(False),
    GeometryObjects=sph,
    Layer="viewpoint",
    ObjectName="viewpoint",
    ObjectColor=RGB(255, 255, 255),
    LayerColor=RGB(255, 255, 255))
panel_9 = Panel(cluster_2)
viewer = Ladybug_ImageViewer(ImagePath_=hdr_tif, _scale_=1, DisableClickable=False, SaveImgWithCoords=False, scale=1)  # -> ImagePath, Colors, GIF
tag = TextTag(Location=area.Centroid, Text=importrad.RADMaterials)

panel_10 = Panel(rundaylightanalysis.studyFolder)
runevalglare = PythonScript(x=Toggle(True), y=panel_10)  # -> out, a
# ---------- runevalglare: Python ----------
import os


path1 = y
path2 = "C:/ladybug/glare02/imageBasedSimulation/evalglare/"


names=os.listdir(path1)
folder_name='evalglare'
if not os.path.exists(path1+folder_name):
    os.makedirs(path1+folder_name)


# load path from grasshopper. 
# lav mappe til filer.
# kør evalglare
# find værdier

imageFiles = [file for file in os.listdir(path1) if file.endswith('_0.HDR')]

for index in range (len(imageFiles)):
   os.system("evalglare.exe -d "+path1+imageFiles[index]+"  > "+path2+str(index)+'eval1.txt')

a = path2
# ---------- end runevalglare ----------

evalglarevalues = PythonScript(y=runevalglare.a)  # -> out, a
# ---------- evalglarevalues: Python ----------
import glob
import os
import rhinoscriptsyntax as rs

path1 = y
list_of_files = glob.glob('C:/ladybug/glare02/imageBasedSimulation/evalglare/*.txt')

names=os.listdir(path1)
folder_name='photo'
if not os.path.exists(path1+folder_name):
    os.makedirs(path1+folder_name)

path = "C:/ladybug/glare02/imageBasedSimulation/evalglare/photo/"
NewFile=os.path.join(path,'evalglare'+".txt")
MyFile = open(NewFile,"w")



for file in list_of_files:

   with open(file) as f:
      data = [x.split() for x in f]

   VC = data[-1]
   Ldata=data[1:-1]

#getting the number of maximum glare sources
   glare = max(l[0] for l in Ldata)


#if no glare source is to be found, some valiues as listed below should be set to their minimum
#Udvælgelse af værdier for omega, pIndex, La, x,y,z værdierne er udvalgt
#ud fra max værdien for Ls og den tilhørende glare source.

   if glare == 0:
      MaxValue=(max( Ldata, key=lambda x:(x[0])))
      M_La     =VC[1]
      M_Ls     =MaxValue[5]
      M_Omega  =MaxValue[6]
      M_pIndex =MaxValue[7]
      M_x      =str(0)
      M_y      =str(0)
      M_z      =str(0)

   elif glare != 0:
      MaxValue=(max( Ldata, key=lambda x:(x[0])))
      M_La     = M_La=VC[1]
      M_Ls     = MaxValue[5]
      M_Omega  = MaxValue[6]
      M_pIndex = MaxValue[7]
      M_x      = MaxValue[14]
      M_y      = MaxValue[15]
      M_z      = MaxValue[16]

      #Export data
      MyFile.write(M_Ls+'\t'+M_La+'\t'+ M_Omega+'\t'+M_pIndex+'\t'+M_x+'\t'+M_y+'\t'+M_z+"\n")
MyFile.close()
# ---------- end evalglarevalues ----------
panel_11 = Panel(evalglarevalues.a)
concat_3 = Concatenate(FragmentA=panel_9, FragmentB=panel_9)
concat_4 = Concatenate(FragmentA=panel_11, FragmentB=panel_9)
panel_12 = Panel(concat_3)
panel_13 = Panel(concat_4)
shift = PythonScript()  # -> out, a
# ---------- shift: Python ----------
import glob
import os
import math

path = "/Users/Susanne/Desktop/python/gaze shift/"
list_of_files = glob.glob('/Users/Susanne/Desktop/python/gaze shift/*.txt')

for file in list_of_files:
   with open(file) as f:
      data = [x.split() for x in f]

   List=data[0]

   Ls     =float(List[0])
   La     =float(List[1])
   Omega  =float(List[2])
   pIndex =float(List[3])
   x_gla  =float(List[4])
   y_gla  =float(List[5])
   z_gla  =float(List[6])
   x_cam  =float(List[7])
   y_cam  =float(List[8])
   z_cam  =float(List[9])


   glareimpact=Ls*Omega/pIndex
   DistAngle=math.acosh(x_gla * x_cam + y_gla * y_cam + z_gla * z_cam)
   Shift = 1.92-0.56*math.log10(glareimpact)/(math.log10(La)*DistAngle)
# ---------- end shift ----------

# ==== cluster Cluster
T = ClusterInput()
rep = ReplaceText(Text=T, Find="}", Replace=" ", RecursiveReplace=False)
rep_2 = ReplaceText(Text=rep, Find=",", RecursiveReplace=False)
R = ClusterOutput(rep_2)

# ==== cluster Cluster_2
T = ClusterInput()
rep = ReplaceText(Text=T, Find="{", Replace=" ", RecursiveReplace=False)
rep_2 = ReplaceText(Text=rep, Find="}", RecursiveReplace=False)
rep_3 = ReplaceText(Text=rep_2, Find=",", RecursiveReplace=False)
R = ClusterOutput(rep_3)
